# Grasshopper definition grasshopper design.gh (Grasshopper 1.0.7)
# plug-ins: HoopSnake, EleFront, Firefly, Weaverbird

# ---- group: ARDUINO READING
number_slider = Slider(3, range=0..10)
toggle = BooleanToggle(True)
open_port = OpenClosePort(OpenClosePort=toggle, PortNumber=number_slider, BaudRate="115200")
timer = Timer(TimerInterval=1, Target=read)
read = SerialReadGeneric(StartReadingValues=toggle, PortNumber=number_slider)  # -> SerialOutput, StatusMessage
dam = DataDam(DataA=read.SerialOutput, BufferDelay=10000000, BufferMode=2)
panel = Panel(read.SerialOutput)
panel_2 = Panel(dam)
split = TextSplit(Text=panel_2, Separators=" ")
panel_3 = Panel(split)

# ---- group: MAGNITUDE
python = GhPythonScript(x=panel_2)  # -> out, list_max
# ---------- python: Python ----------
list_max = 0
x = x.split()
print(x)
for i in range(3,len(x)-1):
    temp = float(x[i])
    if list_max < temp:
        list_max = temp
# ---------- end python ----------
panel_4 = Panel(python.list_max)
larger = LargerThan(FirstNumber=panel_4, SecondNumber=Slider(10, range=0..30))  # -> LargerThan, OrEqualTo
panel_5 = Panel(larger.OrEqualTo)
python_mux = GhPythonScript(a=python.list_max, b=Slider(0, range=0..1), load=larger.OrEqualTo)  # -> out, result
# ---------- python_mux: Python ----------
if load:
    result =  a 
else:
    result = b
# ---------- end python_mux ----------
red_by = Slider(50, range=0..60)
stop_at = Slider(200, range=0..200)
compressor = GhPythonScript(
    input=python_mux.result,
    div_by=Slider(0.3, range=0..30),
    red_by=red_by,
    red_factor=Slider(9, range=0..30),
    stop_at=stop_at)  # -> out, result
# ---------- compressor: Python ----------
if input != 0:
    result = input / div_by
    if abs(result - red_by) > red_factor:
        result = result - red_by
else:
    result = 0
    
if result <= -stop_at:
    result = -stop_at
if result >= stop_at:
    result = stop_at
# ---------- end compressor ----------
panel_6 = Panel(compressor.result)

# ---- group: CONTROL ON NEW OBJECTS
split_2 = TextSplit(Text=panel, Separators=": ,")
panel_7 = Panel(split_2)
item = ListItem(List=split_2, Index="9", Wrap=True)  # -> flatten(Item)
item_2 = ListItem(List=split_2, Index="5", Wrap=True)  # -> flatten(Item)
item_3 = ListItem(List=split_2, Index="3", Wrap=True)  # -> flatten(Item)
panel_8 = Panel(item)
panel_9 = Panel(item_2)
panel_10 = Panel(item_3)
python_2 = GhPythonScript(x=panel_8)  # -> out, intger
# ---------- python_2: Python ----------
intger = int(x.split()[0])
# ---------- end python_2 ----------
python_3 = GhPythonScript(x=panel_10)  # -> out, result
# ---------- python_3: Python ----------
x = x.split()[0]
if x == "1":
    result = True
else:
    result = False
# ---------- end python_3 ----------
python_4 = GhPythonScript(x=panel_9)  # -> out, result; same code as python_3
panel_11 = Panel(python_3.result)
panel_12 = Panel(python_4.result)

# ---- group: FRIQUENCY
item_4 = ListItem(List=panel_3, Index="31", Wrap=True)
python_5 = GhPythonScript(x=item_4)  # -> out, point_to_move
# ---------- python_5: Python ----------
point_to_move = (float(x) % 100) / 100
# ---------- end python_5 ----------

# ----
level_vertices = Slider(7, range=0..20)
msphere = MeshSphere(Base=PlaneXY(0, 0, 0), Radius=30, UCount=level_vertices, VCount=level_vertices)
demesh = DeconstructMesh(Mesh=msphere)  # -> flatten(Vertices), Faces, Colours, Normals
python_6 = GhPythonScript(level_vertices=level_vertices)  # -> out, num_vertices, partition; inputs level_vertices: Int32
# ---------- python_6: Python ----------
num_vertices = (level_vertices*(level_vertices-1) + 2) 

partition = [1] * num_vertices
# ---------- end python_6 ----------
panel_13 = Panel(demesh.Vertices)
panel_14 = Panel(python_6.partition)
swatch = ColourSwatch(SwatchColor=RGB(255, 255, 255))

# ---- group: POINT REACTION TO VOICE
# החלטה אקראית על כיוון התנועה
# החלטה על בחירת הנקודה לפי התדר בצורה מעגלית
panel_15 = Panel("60")
num = Number(0)
panel_16 = Panel(python_5.point_to_move)
dom = ConstructDomain(DomainStart=num, DomainEnd=python_6.num_vertices)
remap = RemapNumbers(Value=panel_16, Source=Domain(0, 1), Target=dom)  # -> Mapped, Clipped
python_7 = GhPythonScript(level=remap.Mapped)  # -> out, path
# ---------- python_7: Python ----------
path = "{0;0;" + str(int(level)) + "}"
# ---------- end python_7 ----------
panel_17 = Panel(python_7.path)

# ---- group: LOCATION FOR BAKING
random = Random(Range=Domain(50, 150), Number=1, Seed=python_2.intger)
int = Integer(random)
multiplication = Multiplication(A=python_2.intger, B=Slider(150, range=0..150))
panel_18 = Panel(multiplication)
subtraction = Subtraction(A=multiplication, B=Slider(300, range=0..1000))
vec = VectorXYZ(XComponent=subtraction, YComponent=int, ZComponent=Slider(0, range=0..100))  # -> Vector, Length
vec_2 = Vector(vec.Vector)

# ---- group: SHOW OBJECT IN PROCESS
swatch_2 = ColourSwatch(SwatchColor=RGB(236, 209, 207))

# ---- group: BAKE DONE OBJECTS
color = DefineColor(Color=swatch_2, Source="object")
attributes = DefineObjectAttributes(Color=color)

# ---- group: POINT REACTION TO VOICE (continued)
mod = Modulus(A=hs.IterationsCounter, B=panel_15)
python_dmux = GhPythonScript(sel=mod, input=compressor.result)  # -> out, a, b, c
# ---------- python_dmux: Python ----------
a = 0
b = 0
c = 0

if sel <= 20:
    a = input
elif sel <= 40:
    b = input
else:
    c = input
# ---------- end python_dmux ----------
vec_3 = VectorXYZ(XComponent=python_dmux.a, YComponent=python_dmux.b, ZComponent=python_dmux.c)  # -> Vector, Length
vec_4 = Vector(vec_3.Vector)
multiplication_2 = Multiplication(A=vec_4, B=Slider(0.1, range=0..1))

# ---- group: LOOP
hs = HoopSnake(
    StartingData=panel_13,
    Data=python_mux_2.result,
    TerminationCondition=Toggle(True),
    Hoopsnake_Data_autoUpdate=False,
    Hoopsnake_Data_dataLimit=2147483647,
    Hoopsnake_Data_delay=0,
    Hoopsnake_Data_resetCounter=True,
    Hoopsnake_Data_updateView=True)  # -> Feedback, FeedbackHistory, LoopsCounter, IterationsCounter
panel_19 = Panel(hs.IterationsCounter)

# ----
partition = PartitionList(List=hs.Feedback, Size=panel_14)
panel_20 = Panel(partition)
split_3 = SplitTree(Data=panel_20, Masks=flatten(python_7.path))  # -> Positive, Negative
panel_21 = Panel(split_3.Positive)
move = Move(Geometry=split_3.Positive, Motion=multiplication_2)  # -> Geometry, Transform
merge = Merge(Data1=move.Geometry, Data2=split_3.Negative)
flatten = FlattenTree(Tree=merge, Path="{0}")
panel_22 = Panel(flatten)
# שכלול פרמטר התדר - הקול האנושי מורכב מהתאבכות של כמה תדרים. נוכל פרק אותו אליהם ולהשתמש בכל אחד מהם באופן בלתי תלוי במקום להשתמש בתדר הדומיננטי בלבד.
python_mux_2 = GhPythonScript(a=panel_13, b=panel_22, load=python_4.result)  # -> out, result; same code as python_mux
conmesh = ConstructMesh(Vertices=python_mux_2.result, Faces=demesh.Faces)  # -> flatten(Mesh)

# ---- group: SHOW OBJECT IN PROCESS (continued)
wbcatmullclark = WeaverbirdsCatmullClarkSubdivision(MeshCurves=conmesh, Level=Slider(3, range=0..10), SmoothNakedEdges=1)
preview_bake_this_as_group = CustomPreview(Geometry=wbcatmullclark, Material=swatch_2)

# ---- group: LOCATION FOR BAKING (continued)
move_2 = Move(Geometry=wbcatmullclark, Motion=vec_2)  # -> Geometry, Transform

# ---- group: BAKE DONE OBJECTS (continued)
# תיבת רעיונות:
# 
# המהירות בה הנקודות זוזות תהיה גם משופעת מפרמטר נקלט.
# 
# המשתמש שולט רק בחלק מהתנועה וחק נוצר לבד
# 
# 
# 
# לשקול לאפשר שינוי הסיבוכיות לאחר הפיסול
# 
# אופציות לטפיחה: אול י מספר הטפיחות יתנו אינדיקציה למורכבות העיגול?
# 
# אולי נשתמש בפיתון מוקס כדי להתחיל צורה חדשה לפי הטפיחה. כלומר, כשיש טפיחה הפרמטר שיכנס ל-
#  D*
# הוא ה
# mash
#  המקורי
bake = BakeObjects(Geometry=move_2.Geometry, Attributes=attributes, Bake=python_3.result)
